vi "index.gviweb"   [LabVIEW NXG 5.0.0]
panel controls:
  "Timezone": string
  "LV Enabled": bool = TRUE
  "LV TZ Update": bool
  "LV OS TZ Update": bool = TRUE
  "Pi OS TZ Update": bool = TRUE
  "LV OS Enabled": bool = TRUE
  "Pi OS Enabled": bool = TRUE
  "Debug Log?": bool
  "Send SystemLink Tags?": bool = TRUE
  "Send SystemLink Messages?": bool = TRUE
panel indicators:
  "Connected?": bool
  "LabVIEW Time": string
  "WebSockets URL": string
  "Last Error": string
  "LabVIEW OS Time": string
  "PI OS Time": string
types:
  T1 = cluster{"WebSockets URL": string, "WebSocket Session": u32, "Connected?": bool, "Message In": string, "Message Out": string, "LV TZ Update?": bool, "LV Time Update?": bool, "LV Time": string, "LV OS TZ Update?": bool, "LV OS Time Update?": bool, "LV OS Time": string, "Pi OS TZ Update?": bool, "Pi OS Time Update?": bool, "Pi OS Time": string, "State Control Refs": "CheckBox reference"[], "Debug Log?": bool, "Send SystemLink Tags?": bool, "Send SystemLink Messages?": bool}
  T2 = cluster{"Command": string, "Controls": cluster{"Name": string, "Value": bool}[]}
uses:
  JKI::Library::JKI State Machine::Add State(s) to Queue.gvi
  JKI::Library::JKI State Machine::Parse State Queue.gvi
  NI::G Core::Error::Build Error Cluster.gvi
  DebugTools::Debug Log.gvi
  WebApp::GetHostname.jsli::GetHostname
  NI::WebSockets::Close WebSocket.gvi
  NI::G Core::Error::Clear Error Cluster.gvi
  NI::WebSockets::Open WebSocket.gvi
  NI::WebSockets::Read String.gvi
  NI::WebSockets::Write String.gvi
diagram:
  call "Add State(s) to Queue.gvi"(State(s) in ("")="Macro: Initialize") -> (States Out=w1)
  # This has been modified from the JKI State Machine NXG 3.0 available at https://github.com/JKISoftware/JKI-State-Machine-NXG/tree/master/source.  Instead of building a package the required VIs have been added to this project.  The items not supported by a Web VI have been removed.
  # = State Syntax =
  # StateCategory: State >> Argument
  # Line Terminator: Line feed
  # Example:
  # UI: Help >> About
  #
  # Where "UI" is the state category
  # Where "Help" is the state
  # Where "About" is the argument
  # Other Examples:
  # App Data: Initialize
  # UI: Initialize
  # Help >> About
  #
  # = Commenting =
  # To add a comment use "//" or "#" and all text to the right will be ignored
  # Commenting Example:
  # UI: Initialize // This initializes the UI
  # # This whole line is a comment
  # // Another comment line
  # For instructions on how to use the JKI State Machine, examples and video tutorials, visit:
  # http://jki.net/state-machine/
  #
  # JKI State Machine™
  # http://jki.net/state-machine/
  # Copyright (C) 2005-2018, JKI <info@jki.net>
  # ALL RIGHTS RESERVED
  s1 = uninitialised  # shift register
  s2 = uninitialised  # shift register
  s3 = w1  # shift register
  while {
    call "Parse State Queue.gvi"(State Queue=s3, Error In (no error)=s2) -> (Remaining States=w2, Current State=w3, Arguments=w4)
    w5 = 10  # Timeout
    # JKI State Machine NXG 3.0				Template Copyright © 2018 JKI	 - http://jki.net/state-machine
    # -1 =
    # wait
    # forever
    case (w3) ignore case {
      frame "", "Event Structure", "Idle" {
        # executes when the state queue is empty
        event (timeout = w5) {
          on "Timeout" {
            Property Node(instance in=s1) -> ("Connected?"=w10)
            Select(s=w10, t="Comm: Read", f="Comm: Connecting") -> w11
            # Timeout Frame
            # (this will only execute if the Event Structure timeout is >= 0)
            call "Add State(s) to Queue.gvi"(State(s) in Front ("")=w11, State(s) in ("")=w2, State(s) at Back ("")="UI: Update") -> (States Out=w7)
            w6 = s2
            w9 = s1
          }
          on "Timezone" Value changed {
            call "Add State(s) to Queue.gvi"(State(s) in Front ("")="UI: Process Timezone", State(s) in ("")=w2) -> (States Out=w7)
            w6 = s2
            w9 = s1
          }
          on "LV Enabled" Value changed; "LV OS Enabled" Value changed; "LV OS TZ Update" Value changed; "LV TZ Update" Value changed; "Pi OS Enabled" Value changed; "Pi OS TZ Update" Value changed; "Send SystemLink Messages?" Value changed; "Send SystemLink Tags?" Value changed {
            Event Data() -> ("New Value"=w12, "Control Reference"=w13)
            Property Node(instance in=w13) -> ("Label"=w14)
            Property Node(instance in=w14) -> ("Text"=w15)
            Format Into String(formatString="UI: Process Boolean >> %s,%s", w15, w12) -> w16
            call "Add State(s) to Queue.gvi"(State(s) in Front ("")=w16, State(s) in ("")=w2) -> (States Out=w7)
            w6 = s2
            w9 = s1
          }
          on "Debug Log?" Value changed {
            Event Data() -> ("New Value"=w17)
            Property Node(instance in=s1, "Debug Log?"=w17) -> (instance out=w9)
            w7 = w2
            w6 = s2
          }
        }
        w8 = default
      }
      frame "---------- Core ----------" {
        # Do not put any code in this frame.
        # (it is a separator no-op)
        call "Add State(s) to Queue.gvi"(State(s) in ("")=w2) -> (States Out=w7)
        w6 = s2
        w8 = default
        w9 = s1
      }
      frame Default {
        # Do not delete, rename, or modify this frame.
        # (this is used to capture unhandled states and typos)
        call "Add State(s) to Queue.gvi"(State(s) in ("")=w2) -> (States Out=w7)
        Format Into String(formatString="Software Exception: Unhandled State \"%s\".", errIn=s2, w3) -> (outString=w18, errOut=w19)
        # Handle mistyped state name (developer tool)
        call "Build Error Cluster.gvi"(code="Generic error"(42), description=w18, error in=w19, include call chain=TRUE) -> (error out=w6)
        w8 = default
        w9 = s1
      }
      frame "Error Handler" {
        # Handle any errors here.
        # You can also output any states to clean-up after errors occur
        call "Add State(s) to Queue.gvi"(State(s) in Front ("")="/* Post Error States", State(s) in ("")=w2) -> (States Out=w7)
        call "Debug Log.gvi"(prefix=w3, value=s2)
        Property Node(instance in=s2) -> ("code"=w20, "source"=w21)
        # Unhandled Error -- Display it
        Get Current Time() -> (current time=w22)
        Format Into String(formatString="%<%c>T\nCode: %d\n%s", w22, w20, w21) -> w23
        $"Last Error" <- w23
        # Clear error
        w6 = no error
        w8 = default
        w9 = s1
      }
      frame "Exit" {
        # Do not put any code in this frame.
        # (No errors that occur here will be handled.)
        call "Add State(s) to Queue.gvi"(State(s) in ("")=w2) -> (States Out=w7)
        w24 = TRUE  # Stop
        w6 = s2
        w8 = w24
        w9 = s1
      }
      frame "---------- Data ----------" {
        # Do not put any code in this frame.
        # (It is a separator no-op. You can make a copy of this frame to create a new Data frame)
        call "Add State(s) to Queue.gvi"(State(s) in ("")=w2) -> (States Out=w7)
        w6 = s2
        w8 = default
        w9 = s1
      }
      frame "Data: Initialize" {
        # Initialize the shift-register data, here.
        # (data names are defined by what you wire into the bundle function)
        call "Add State(s) to Queue.gvi"(State(s) in ("")=w2) -> (States Out=w7)
        # Add new data here.
        w25 = T1 {"LV Time Update?"=TRUE, "LV OS TZ Update?"=TRUE, "LV OS Time Update?"=TRUE, "Pi OS TZ Update?"=TRUE, "Pi OS Time Update?"=TRUE, "Send SystemLink Tags?"=TRUE, "Send SystemLink Messages?"=TRUE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}
        Build Array(reference to "LV Enabled", reference to "LV OS Enabled", reference to "Pi OS Enabled", reference to "LV TZ Update", reference to "LV OS TZ Update", reference to "Pi OS TZ Update", reference to "Send SystemLink Tags?", reference to "Send SystemLink Messages?") -> w26
        # Data names and types of shift register data are defined by this bundle.
        Property Node(instance in=w25, "State Control Refs"=w26) -> (instance out=w9)
        w6 = s2
        w8 = default
      }
      frame "Data: Cleanup" {
        # Cleanup any data and references, here.
        # (this is called automatically, by the Macro: Exit)
        call "Add State(s) to Queue.gvi"(State(s) in ("")=w2) -> (States Out=w7)
        w6 = s2
        w8 = default
        w9 = s1
      }
      frame "---------- UI ----------" {
        # Do not put any code in this frame.
        # (It is a separator no-op. You can make a copy of this frame to create a new UI frame)
        call "Add State(s) to Queue.gvi"(State(s) in ("")=w2) -> (States Out=w7)
        w6 = s2
        w8 = default
        w9 = s1
      }
      frame "UI: Initialize" {
        # Initialize the User Interface, here.
        # (this is called automatically, by the Macro: Init)
        call "Add State(s) to Queue.gvi"(State(s) in ("")=w2) -> (States Out=w7)
        $"Last Error" <- ""
        Property Node(instance in=s1) -> ("Debug Log?"=w27, "State Control Refs"=w28, "LV Time Update?"=w29, "LV OS Time Update?"=w30, "Pi OS Time Update?"=w31, "LV TZ Update?"=w32, "LV OS TZ Update?"=w33, "Pi OS TZ Update?"=w34, "Send SystemLink Tags?"=w35, "Send SystemLink Messages?"=w36)
        Property Node(instance in=reference to "Debug Log?", "Value"=w27)
        Build Array(w29, w30, w31, w32, w33, w34, w35, w36) -> w37
        for {
          w38 = each element of w28
          w39 = each element of w37
          Property Node(instance in=w38, "Value"=w39)
        }
        w6 = s2
        w8 = default
        w9 = s1
      }
      frame "UI: Update" {
        # Update the User Interface, here.
        # (this is called automatically, by the Macro: Init and during Timeout)
        call "Add State(s) to Queue.gvi"(State(s) in ("")=w2) -> (States Out=w7)
        Property Node(instance in=s1) -> ("WebSockets URL"=w40, "Connected?"=w41, "LV Time"=w42, "LV OS Time"=w43, "Pi OS Time"=w44)
        $"WebSockets URL" <- w40
        $"Connected?" <- w41
        $"LabVIEW Time" <- w42
        $"LabVIEW OS Time" <- w43
        $"PI OS Time" <- w44
        w6 = s2
        w8 = default
        w9 = s1
      }
      frame "UI: Process Timezone" {
        # UI: Process Timezone
        # (Process the Timezone change from the UI.)
        call "Add State(s) to Queue.gvi"(State(s) in ("")=w2, State(s) at Back ("")="Comm: Write") -> (States Out=w7)
        Property Node(instance in=reference to "Timezone", error in=s2) -> ("Value"=w45, error out=w46)
        w47 = cluster{"Command": string, "Timezone": string} {all zero or empty}
        Property Node(instance in=w47, "Command"="Timezone", "Timezone"=w45) -> (instance out=w48)
        Flatten To Json(anything=w48, error in (no error)=w46) -> (JSON string=w49, error out=w6)
        Property Node(instance in=s1, "Message Out"=w49) -> ("Debug Log?"=w50, instance out=w9)
        case (w50) {
          frame False, Default { }
          frame True {
            call "Debug Log.gvi"(prefix=w3, value=w9)
          }
        }
        w8 = default
      }
      frame "UI: Process Web UI State" {
        # UI: Process Web UI State
        # (Get the current state of the state controls and send to the program.)
        call "Add State(s) to Queue.gvi"(State(s) in Front ("")="Comm: Write", State(s) in ("")=w2) -> (States Out=w7)
        Property Node(instance in=s1) -> ("State Control Refs"=w51)
        s4 = s2  # shift register
        for {
          w52 = each element of w51
          Property Node(instance in=w52, error in=s4) -> ("Value"=w54, "Label"=w55, error out=w56)
          Property Node(instance in=w55, error in=w56) -> ("Text"=w57, error out=w58)
          Property Node(instance in=cluster{"Name": string, "Value": bool} {all zero or empty}, "Name"=w57, "Value"=w54) -> (instance out=w59)
          append w59 to w53
          next s4 = w58
        }
        Property Node(instance in=T2 {all zero or empty}, "Command"="Web UI State", "Controls"=w53) -> (instance out=w60)
        Flatten To Json(anything=w60, error in (no error)=s4) -> (JSON string=w61, error out=w6)
        Property Node(instance in=s1, "Message Out"=w61) -> (instance out=w9)
        w8 = default
      }
      frame "UI: Process Sync Web UI" {
        # UI: Process Sync Web UI
        # (Set the current state of the state controls to the Web UI.)
        call "Add State(s) to Queue.gvi"(State(s) in ("")=w2) -> (States Out=w7)
        Property Node(instance in=s1) -> ("Message In"=w62, "State Control Refs"=w63)
        Unflatten From Json(JSON string=w62, path=["Controls"], type and defaults=cluster{"Name": string, "Value": bool}[] []) -> (value=w64)
        for {
          w65 = each element of w64
          Property Node(instance in=w65) -> ("Value"=w67, "Name"=w68)
          s5 = s2  # shift register
          for {
            w69 = each element of w63
            Property Node(instance in=w69, error in=s5) -> ("Label"=w70, error out=w71, instance out=w72)
            Property Node(instance in=w70, error in=w71) -> ("Text"=w73, error out=w74)
            Is Equal(x=w68, y=w73) -> w75
            # For each available control.
            case (w75) {
              frame False, Default {
                # Control not found.
                w76 = w74
              }
              frame True {
                # Found control, set value.
                Property Node(instance in=w72, "Value"=w67, error in=w74) -> (error out=w76)
              }
            }
            next s5 = w76
            stop if w75
          }
          # For each control received.
          w77 = error {"status"=TRUE, "code"=5000, "source"="Unknown Boolean Command: %s"}
          Property Node(instance in=w77) -> ("source"=w78, instance out=w79)
          Format Into String(formatString=w78, w68) -> w80
          Property Node(instance in=w79, "source"=w80) -> (instance out=w81)
          Select(s=w75, t=s5, f=w81) -> w82
          append w82 to w66
        }
        Merge Errors(w66) -> (error out=w6)
        w8 = default
        w9 = s1
      }
      frame "UI: Process Boolean" {
        # UI: Process Boolean
        # (Process a boolean change from the UI.)
        call "Add State(s) to Queue.gvi"(State(s) in ("")=w2, State(s) at Back ("")="Comm: Write") -> (States Out=w7)
        Search Or Split String(search string/char=",", string=w4) -> (match + rest of string=w83, substring before match=w84)
        String Subset(offset (0)=1, string=w83) -> w85
        Scan From String(inputString=w85, default=FALSE) -> (out0=w86)
        w87 = cluster{"Command": string, "Enabled?": bool} {all zero or empty}
        Property Node(instance in=w87, "Command"=w84, "Enabled?"=w86) -> (instance out=w88)
        Flatten To Json(anything=w88, error in (no error)=s2) -> (JSON string=w89, error out=w6)
        Property Node(instance in=s1, "Message Out"=w89) -> ("Debug Log?"=w90, instance out=w9)
        case (w90) {
          frame False, Default { }
          frame True {
            call "Debug Log.gvi"(prefix=w3, value=w9)
          }
        }
        w8 = default
      }
      frame "UI: Process LV Time" {
        # UI: Process LV Time
        # (Process the LV Time Update.)
        call "Add State(s) to Queue.gvi"(State(s) in ("")=w2) -> (States Out=w7)
        Property Node(instance in=s1) -> ("Message In"=w91, instance out=w92)
        Unflatten From Json(JSON string=w91, error in (no error)=s2, path=["LV Time"], type and defaults=string "") -> (error out=w6, value=w93)
        Property Node(instance in=w92, "LV Time"=w93) -> (instance out=w9)
        w8 = default
      }
      frame "UI: Process LV OS Time" {
        # UI: Process LV OS Time
        # (Process the LV OS Time Update.)
        call "Add State(s) to Queue.gvi"(State(s) in ("")=w2) -> (States Out=w7)
        Property Node(instance in=s1) -> ("Message In"=w94, instance out=w95)
        Unflatten From Json(JSON string=w94, error in (no error)=s2, path=["LV OS Time"], type and defaults=string "") -> (error out=w6, value=w96)
        Property Node(instance in=w95, "LV OS Time"=w96) -> (instance out=w9)
        w8 = default
      }
      frame "UI: Process Pi OS Time" {
        # UI: Process Pi OS Time
        # (Process the Pi OS Time Update.)
        call "Add State(s) to Queue.gvi"(State(s) in ("")=w2) -> (States Out=w7)
        Property Node(instance in=s1) -> ("Message In"=w97, instance out=w98)
        Unflatten From Json(JSON string=w97, error in (no error)=s2, path=["Pi OS Time"], type and defaults=string "") -> (error out=w6, value=w99)
        Property Node(instance in=w98, "Pi OS Time"=w99) -> (instance out=w9)
        w8 = default
      }
      frame "---------- Macro ----------" {
        # Do not put any code in this frame.
        # (It is a separator no-op. You can make a copy of this frame to create a new Macro frame)
        call "Add State(s) to Queue.gvi"(State(s) in ("")=w2) -> (States Out=w7)
        w6 = s2
        w8 = default
        w9 = s1
      }
      frame "Macro: Initialize" {
        w100 = "Data: Initialize\nUI: Initialize\nUI: Update\nComm: Initialize\nUI: Update"
        # Initialization Macro
        # (This is called once, when the VI starts)
        call "Add State(s) to Queue.gvi"(State(s) in Front ("")=w100, State(s) in ("")=w2) -> (States Out=w7)
        w6 = s2
        w8 = default
        w9 = s1
      }
      frame "Macro: Exit" {
        # Exit Macro
        # (This is called once, when the VI exits)
        call "Add State(s) to Queue.gvi"(State(s) in Front ("")="Data: Cleanup\nExit", State(s) in ("")=w2) -> (States Out=w7)
        w6 = s2
        w8 = default
        w9 = s1
      }
      frame "---------- Comm ----------" {
        # Template Separator
        # (You can make a copy of, or modify, this frame)
        call "Add State(s) to Queue.gvi"(State(s) in ("")=w2) -> (States Out=w7)
        w6 = s2
        w8 = default
        w9 = s1
      }
      frame "Comm: Initialize" {
        # Comm: Initialize
        # (Establishes a connection with the webserver.)
        call "Add State(s) to Queue.gvi"(State(s) in ("")=w2) -> (States Out=w7)
        # Change this according to whether it's being hosted on the Pi (e.g. localhost) or you are accessing remotely (Pi IP address)
        disable {
          frame Enabled {
            # Use to test running locally.
            w6 = default
            w101 = "ws://labviewpi:6123"
          }
          frame Disabled {
            call "GetHostname"() -> (return=w102, error out=w103)
            Format Into String(formatString="ws://%s:6123", errIn=w103, w102) -> (outString=w101, errOut=w6)
          }
        }
        Property Node(instance in=s1, "WebSockets URL"=w101) -> (instance out=w9)
        w8 = default
      }
      frame "Comm: Connecting" {
        # Comm: Connecting
        # (Establish a WebSockets connection.)
        call "Add State(s) to Queue.gvi"(State(s) in ("")=w2) -> (States Out=w7)
        Property Node(instance in=s1) -> ("WebSockets URL"=w104, "WebSocket Session"=w105, instance out=w106)
        call "Close WebSocket.gvi"(websocket session in=w105, error in=s2) -> (error out=w107)
        call "Clear Error Cluster.gvi"(error in=w107) -> (error out=w108)
        call "Open WebSocket.gvi"(url=w104, error in=w108) -> (websocket session out=w109, error out=w110)
        Not(x=w110) -> w111
        Property Node(instance in=w106, "WebSocket Session"=w109, "Connected?"=w111) -> (instance out=w9)
        call "Clear Error Cluster.gvi"(error in=w110) -> (error out=w6)
        w8 = default
      }
      frame "Comm: Read" {
        Property Node(instance in=s1) -> ("WebSocket Session"=w112, instance out=w113)
        call "Read String.gvi"(websocket session in=w112, timeout=5, error in=s2) -> (websocket session out=w114, string response=w115, error out=w116)
        # Comm: Read
        # (Read any available message.)
        Select(s=w116, t="", f="Comm: Process") -> w117
        call "Add State(s) to Queue.gvi"(State(s) in Front ("")=w117, State(s) in ("")=w2) -> (States Out=w7)
        Not(x=w116) -> w118
        Property Node(instance in=w113, "WebSocket Session"=w114, "Message In"=w115, "Connected?"=w118) -> (instance out=w9)
        call "Clear Error Cluster.gvi"(error in=w116) -> (error out=w6)
        w8 = default
      }
      frame "Comm: Write" {
        # Comm: Write
        # (Write available message.)
        call "Add State(s) to Queue.gvi"(State(s) in ("")=w2) -> (States Out=w7)
        Property Node(instance in=s1) -> ("WebSocket Session"=w119, "Message Out"=w120, instance out=w121)
        call "Write String.gvi"(websocket session in=w119, string message=w120, error in=s2) -> (websocket session out=w122, error out=w123)
        Not(x=w123) -> w124
        Property Node(instance in=w121, "WebSocket Session"=w122, "Connected?"=w124) -> (instance out=w9)
        call "Clear Error Cluster.gvi"(error in=w123) -> (error out=w6)
        w8 = default
      }
      frame "Comm: Process" {
        Property Node(instance in=s1) -> ("Message In"=w125)
        Unflatten From Json(JSON string=w125, error in (no error)=s2, path=["Command"], type and defaults=string "") -> (error out=w126, value=w127)
        Format Into String(formatString="UI: Process %s", errIn=w126, w127) -> (outString=w128, errOut=w6)
        # Comm: Process
        # (Process message.)
        call "Add State(s) to Queue.gvi"(State(s) in Front ("")=w128, State(s) in ("")=w2) -> (States Out=w7)
        w8 = default
        w9 = s1
      }
    }
    next s1 = w9
    next s2 = w6
    next s3 = w7
    stop if w8
  }
